# Grasshopper definition unnamedC.gh (Grasshopper 1.0.8)

py3 = Python3Script()  # -> geo, dbg
# ---------- py3: Python ----------
import Rhino
import json

# GH Python INPUTS:
# - CITY_MESHES_JSON (Text)  optional
# - cityMeshesJson   (Text)  optional alias
#
# GH Python OUTPUTS:
# - geo    (List[Rhino.Geometry.Mesh])
# - meshes (List[Rhino.Geometry.Mesh]) alias
# - dbg    (Text)


def _coerce_str(v):
    try:
        if v is None:
            return None
        if isinstance(v, str):
            s = v.strip()
            return s if s else None
        return str(v)
    except:
        return None


def _decode_city_meshes_json_payload(v):
    try:
        if v is None:
            return None

        if isinstance(v, dict):
            return v

        if isinstance(v, str):
            s = v.strip()
            if not s:
                return None
            try:
                return json.loads(s)
            except:
                return None

        s = _coerce_str(v)
        if not s:
            return None
        try:
            return json.loads(s)
        except:
            return None
    except:
        return None


def _build_rhino_mesh_from_arrays(vertices, faces):
    try:
        if not isinstance(vertices, list) or not isinstance(faces, list):
            return None
        if len(vertices) < 9 or (len(vertices) % 3) != 0:
            return None
        if len(faces) < 3 or (len(faces) % 3) != 0:
            return None

        m = Rhino.Geometry.Mesh()

        vcount = int(len(vertices) / 3)
        for i in range(vcount):
            x = vertices[i * 3 + 0]
            y = vertices[i * 3 + 1]
            z = vertices[i * 3 + 2]
            try:
                m.Vertices.Add(float(x), float(y), float(z))
            except:
                m.Vertices.Add(0.0, 0.0, 0.0)

        fcount = int(len(faces) / 3)
        for fi in range(fcount):
            a = faces[fi * 3 + 0]
            b = faces[fi * 3 + 1]
            c = faces[fi * 3 + 2]
            try:
                m.Faces.AddFace(int(a), int(b), int(c))
            except:
                pass

        try:
            m.Normals.ComputeNormals()
        except:
            pass

        try:
            m.Compact()
        except:
            pass

        try:
            if hasattr(m, "IsValid") and (not m.IsValid):
                return None
        except:
            pass

        return m
    except:
        return None


def _decode_city_meshes(v):
    payload = _decode_city_meshes_json_payload(v)
    if not isinstance(payload, dict):
        return []

    meshes_data = payload.get("meshes", None)
    if not isinstance(meshes_data, list):
        return []

    out = []
    for it in meshes_data:
        if not isinstance(it, dict):
            continue
        verts = it.get("vertices", None)
        fac = it.get("faces", None)
        m = _build_rhino_mesh_from_arrays(verts, fac)
        if m is not None:
            out.append(m)
    return out


# Safe defaults if this script executes without GH providing inputs
try:
    CITY_MESHES_JSON
except NameError:
    CITY_MESHES_JSON = None

try:
    cityMeshesJson
except NameError:
    cityMeshesJson = None


payload_in = CITY_MESHES_JSON if CITY_MESHES_JSON is not None else cityMeshesJson

city_meshes = []
err = None
try:
    city_meshes = _decode_city_meshes(payload_in)
except Exception as e:
    err = str(e)
    city_meshes = []

geo = city_meshes
meshes = city_meshes

dbg = json.dumps(
    {
        "geo_meshes": len(city_meshes) if city_meshes else 0,
        "has_CITY_MESHES_JSON": CITY_MESHES_JSON is not None,
        "has_cityMeshesJson": cityMeshesJson is not None,
        "err": err,
    },
    ensure_ascii=False,
)
# ---------- end py3 ----------
panel = Panel(py3.dbg)
# FIX Reset button. Ensure that when you run it resets
panel_2 = Panel(py3.geo)
geo = Geometry(py3.geo)

# ---- group: RH_OUT
mesh = Mesh()
